# Dynamo graph script.dyn "align sketch lines" (Dynamo 2.12.1.8246)
# packages: spring nodes 210.1.1, Bang! 2021.4.3

# group: Select Warning Type
all_warnings_of_type = WarningsOfType("Line in Sketch is slightly off axis and may c.....")
description = Bang.Revit.Elements.Warning.Description(warning=all_warnings_of_type)
uniqueItems = List.UniqueItems(list=description)
failingElements = Bang.Revit.Elements.Warning.FailingElements(warning=all_warnings_of_type)

# group: Select Elements by ID
flatten = List.Flatten(list=failingElements)
string_from_object = FromObject(object=flatten)
code_block = CodeBlock { "ModelCurve"; }
eq = string_from_object == code_block
filterByBoolMask = List.FilterByBoolMask(list=flatten, mask=eq)

# group: Correct Rotation of Sketch Lines
getLocation = Element.GetLocation(element=filterByBoolMask.in)
direction = Line.Direction(line=getLocation)
normalized = Vector.Normalized(vector=direction)
X = Vector.X(vector=normalized)
code_block_2 = CodeBlock { 0; }
round = Math.Round(number=X, digits=code_block_2)
Y = Vector.Y(vector=normalized)
round_2 = Math.Round(number=Y, digits=code_block_2)

# group: Execute The Rotation Correction
startPoint = Curve.StartPoint(curve=getLocation)
byCoordinates = Vector.ByCoordinates(x=round, y=round_2)
length = Curve.Length(curve=getLocation)
byStartPointDirectionLength = Line.ByStartPointDirectionLength(startPoint=startPoint, direction=byCoordinates, length=length)
ꟿ_element_setlocation = Custom[ꟿ Element.SetLocation](element=filterByBoolMask.in, location=byStartPointDirectionLength)  # package spring nodes
